# Grasshopper definition main.gh (Grasshopper 1.0.7)
# plug-ins: Human

xy_plane = XYPlane(Origin=Point(0, 0, 0))
unit_z = UnitZ(Factor=1)
height = Slider(2100, range=0..10000)
branch_sections = Slider(18, range=8..18)
# @paburghelea
trunk = Slider(0.18, range=0..0.3)

line_sdl = LineSDL(Start=xy_plane, Direction=unit_z, Length=height)
shatter = Shatter(Curve=reparameterize(line_sdl), Parameters=trunk)
list_item = ListItem(List=reverse(shatter), Index=0, Wrap=True)

# ---- group: Animate
curve = Curve(reparameterize(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))
rotate = Rotate(Geometry=curve, Angle=degrees("90"), Plane=PlaneXY(0, 0, 0))  # -> Geometry, Transform
evaluate_curve = EvaluateCurve(Curve=rotate.Geometry, Parameter=Slider(0, range=0..1))  # -> Point, Tangent, Angle

curve_middle = CurveMiddle(Curve=line_sdl)
c_script = CSharpScript(camTarget=curve_middle, camPosition=evaluate_curve.Point)  # -> A; inputs camTarget: Point3d, camPosition: Point3d
# ---------- c_script: C# ----------
    RhinoDocument.Views.ActiveView.ActiveViewport.SetCameraLocations(camTarget, camPosition);
# ---------- end c_script ----------

# ----
construct_domain = ConstructDomain(DomainStart=Slider(26, range=0..100), DomainEnd=Slider(131, range=0..200))

create_stem = CreateStem(line=line_sdl, twists=Slider(6, range=0..10), stem_size=construct_domain)

divide_curve = DivideCurve(Curve=list_item, Count=branch_sections, Kinks=False)  # -> Points, Tangents, Parameters

construct_domain_2 = ConstructDomain(DomainStart=Slider(1440, range=0..1440), DomainEnd=Slider(244, range=0..1000))

list_length = ListLength(List=divide_curve.Points)
series = Series(Start=0, Step=Slider(32, range=0..100), Count=list_length)  # -> graft(Series)
range = Range(Domain=construct_domain_2, Steps=expr("x-1", list_length))  # -> simplify(graft(Range))
construct_plane = ConstructPlane(Origin=divide_curve.Points, XAxis=Vector(1, 0, 0), YAxis=Vector(0, 1, 0))  # -> graft(Plane)
rotate_2 = Rotate(Geometry=construct_plane, Angle=degrees(series), Plane=construct_plane)  # -> Geometry, Transform

plane = Plane(rotate_2.Geometry)
radius = Number(range)
division = Division(A=radius, B="1.6")
circle = Circle(Plane=plane, Radius=division)  # -> simplify(Circle)

add_branch = AddBranch(plane=rotate_2.Geometry, offset=Slider(300, range=0..1000), radius=range, divisions=Slider(10, range=0..24))  # -> brep_2, structure_2
project = Project(Curve=add_branch.structure_2, Brep=add_branch.brep_2, Direction=Vector(0, 0, 1))  # -> simplify(Curve)

brep = Brep(add_branch.brep_2)
tree_statistics = TreeStatistics(Tree=brep)  # -> Paths, Length, Count
list_item_2 = ListItem(List=tree_statistics.Paths, Index=-1, Wrap=True)
split_tree = SplitTree(Data=brep, Masks=flatten(list_item_2))  # -> Positive, Negative
brep_2 = Brep(split_tree.Positive)

add_decoration = AddDecoration(
    position=circle,
    branches=add_branch.brep_2,
    radius="12",
    count=Slider(20, range=0..100),
    radius_2=Slider(20, range=0..100))  # -> pipe_2, sphere_2

construct_domain_3 = ConstructDomain(DomainStart=Slider(26, range=0..100), DomainEnd=Slider(36, range=0..100))

add_star = AddStar(brep=brep_2, number=Slider(180, range=0..1000), integer=Slider(5, range=0..10))  # -> line_2, brep_4, line_4

brep_edges = BrepEdges(Brep=add_branch.brep_2)  # -> Naked, Interior, NonManifold
add_bulbs = AddBulbs(outline=brep_edges.Naked, sizes=construct_domain_3, drop=Slider(10, range=0..100))  # -> flatten(sphere_2)
custom_preview = CustomPreview(Geometry=add_bulbs, Material=ColourSwatch(SwatchColor=RGB(255, 0, 0)))

brep_3 = Brep(create_stem)
brep_edges_2 = BrepEdges(Brep=brep_3)  # -> Naked, Interior, NonManifold
custom_preview_2 = CustomPreview(Geometry=brep_3, Material=ColourSwatch(SwatchColor=RGB(166, 71, 17)))
custom_preview_lineweights = CustomPreviewLineweights(Geometry=brep_edges_2.Naked, Shader=ColourSwatch(SwatchColor=RGB(135, 47, 0)), Thickness="5", Absolute=False)
custom_preview_lineweights_2 = CustomPreviewLineweights(Geometry=brep_edges_2.Interior, Shader=ColourSwatch(SwatchColor=RGB(186, 65, 0)), Absolute=False)

dispatch = Dispatch(List=add_decoration.sphere_2, DispatchPattern=[True, False])  # -> ListA, ListB
custom_preview_3 = CustomPreview(Geometry=add_decoration.pipe_2, Material=ColourSwatch(SwatchColor=RGB(255, 242, 178)))
custom_preview_4 = CustomPreview(Geometry=dispatch.ListA, Material=ColourSwatch(SwatchColor=RGB(0, 111, 255)))
custom_preview_5 = CustomPreview(Geometry=dispatch.ListB, Material=ColourSwatch(SwatchColor=RGB(255, 196, 0)))

custom_preview_lineweights_3 = CustomPreviewLineweights(Geometry=add_star.line_2, Shader=ColourSwatch(SwatchColor=RGB(74, 57, 0)), Absolute=False)
custom_preview_6 = CustomPreview(Geometry=add_star.brep_4, Material=ColourSwatch(SwatchColor=RGB(255, 196, 0)))
custom_preview_lineweights_4 = CustomPreviewLineweights(Geometry=add_star.line_4, Shader=ColourSwatch(SwatchColor=RGB(74, 57, 0)), Thickness=4, Absolute=False)

brep_4 = Brep(flatten(add_branch.brep_2))
dash_pattern = DashPattern(Curve=project, Pattern=20)  # -> Dashes, Gaps
brep_edges_3 = BrepEdges(Brep=brep_4)  # -> Naked, Interior, NonManifold
custom_preview_lineweights_5 = CustomPreviewLineweights(Geometry=dash_pattern.Dashes, Shader=ColourSwatch(SwatchColor=RGB(21, 178, 0)), Absolute=False)
custom_preview_lineweights_6 = CustomPreviewLineweights(Geometry=brep_edges_3.Naked, Shader=ColourSwatch(SwatchColor=RGB(61, 255, 61)), Thickness=4, Absolute=False)

merge = Merge(Data1=ColourSwatch(SwatchColor=RGB(21, 127, 0)), Data2=ColourSwatch(SwatchColor=RGB(90, 185, 0)))
list_length_2 = ListLength(List=brep_4)
repeat_data = RepeatData(Data=merge, Length=list_length_2)

custom_preview_7 = CustomPreview(Geometry=brep_4, Material=repeat_data)

# ==== cluster AddStar
brep = ClusterInput()
brep_2 = Brep(brep)
brep_edges = BrepEdges(Brep=brep_2)  # -> Naked, Interior, NonManifold
join_curves = JoinCurves(Curves=brep_edges.Naked, Preserve=False)
divide_curve = DivideCurve(Curve=join_curves, Count=10, Kinks=True)  # -> Points, Tangents, Parameters
average = Average(Input=divide_curve.Points)
unit_z = UnitZ(Factor=1)
unit_z_2 = UnitZ(Factor=1)
project_point = ProjectPoint(Point=average, Direction=unit_z, Geometry=brep_2)  # -> Point, Index
number = ClusterInput()
integer = ClusterInput()
number_2 = Number(number)
unit_z_3 = UnitZ(Factor=expr("x/2", number_2))
move = Move(Geometry=project_point.Point, Motion=unit_z_3)  # -> Geometry, Transform
construct_plane = ConstructPlane(Origin=move.Geometry, XAxis=unit_z_2, YAxis=Vector(0, 1, 0))
deconstruct_plane = DeconstructPlane(Plane=construct_plane)  # -> Origin, XAxis, YAxis, ZAxis
integer_2 = Integer(integer)
amplitude = Amplitude(Vector=deconstruct_plane.ZAxis, Amplitude=expr("x/4", number_2))
point = Point(construct_plane)
polygon = Polygon(Plane=construct_plane, Radius=expr("x/1.8", number_2), Segments=integer_2, FilletRadius=0)  # -> Polygon, Length
polygon_2 = Polygon(Plane=construct_plane, Radius=number_2, Segments=integer_2, FilletRadius=0)  # -> Polygon, Length
negative = Negative(Value=amplitude)
move_2 = Move(Geometry=point, Motion=[amplitude, negative])  # -> Geometry, Transform
explode = Explode(Curve=polygon.Polygon, Recursive=True)  # -> Segments, Vertices
discontinuity = Discontinuity(Curve=polygon_2.Polygon, Level=1)  # -> Points, Parameters
curve_middle = CurveMiddle(Curve=explode.Segments)
weave = Weave(Pattern=[0, 1], Stream0=discontinuity.Points, Stream1=curve_middle, NullGaps=False)
polyline = PolyLine(Vertices=weave, Closed=True)
extrude_point = ExtrudePoint(Base=polyline, Point=move_2.Geometry)
brep_edges_2 = BrepEdges(Brep=extrude_point)  # -> flatten(Naked), Interior, NonManifold
curve_middle_2 = CurveMiddle(Curve=brep_edges_2.Naked)
brep_join = BrepJoin(Breps=extrude_point)  # -> Breps, Closed
brep_edges_3 = BrepEdges(Brep=brep_join.Breps)  # -> Naked, Interior, NonManifold
cull_duplicates = CullDuplicates(Points=curve_middle_2, Tolerance=0.1, CullMode=1)  # -> Points, Indices, Valence
line = Line(brep_edges_3.Interior)
brep_3 = Brep(brep_join.Breps)
line_2 = ClusterOutput(line)
brep_4 = ClusterOutput(brep_3)
list_item = ListItem(List=brep_edges_2.Naked, Index=cull_duplicates.Indices, Wrap=True)
line_3 = Line(list_item)
line_4 = ClusterOutput(line_3)

# ==== cluster CreateStem
twists = ClusterInput()
twists_2 = Integer(twists)
series = Series(Start=0, Step="12", Count=twists_2)
stem_size = ClusterInput()
stem_size_2 = Domain(stem_size)
range = Range(Domain=stem_size_2, Steps=twists_2)  # -> reverse(Range)
line = ClusterInput()
line_2 = Line(line)
perp_frames = PerpFrames(Curve=line_2, Count=twists_2, Align=True)  # -> Frames, Parameters
rotate = Rotate(Geometry=perp_frames.Frames, Angle=degrees(series), Plane=perp_frames.Frames)  # -> Geometry, Transform
polygon = Polygon(Plane=rotate.Geometry, Radius=range, Segments=6, FilletRadius=0)  # -> Polygon, Length
fillet = Fillet(Curve=polygon.Polygon, Radius="24")
loft = Loft(Curves=fillet, Options={Adjust=False, Closed=False, LoftEnds=0, LoftSimp=0, LoftType=0, Rebuild=10, Refit=0.01})
brep = Brep(loft)
brep_2 = ClusterOutput(brep)

# ==== cluster AddBulbs
outline = ClusterInput()
outline_2 = Curve(flatten(outline))
length = Length(Curve=outline_2)
division = Division(A=length, B="200")
list_indices = ListIndices(List=outline_2)
populate_geometry = PopulateGeometry(Geometry=outline_2, Count=division, Seed=list_indices)
sizes = ClusterInput()
sizes_2 = Domain(sizes)

list_length = ListLength(List=outline_2)
random = Random(Range=sizes_2, Number=list_length, Seed=2)

drop = ClusterInput()

drop_2 = Number(drop)
addition = Addition(A=random, B=drop_2)
unit_z = UnitZ(Factor=addition)

move = Move(Geometry=populate_geometry, Motion=expr("-x", unit_z))  # -> Geometry, Transform
sphere = Sphere(Base=move.Geometry, Radius=random)
sphere_2 = ClusterOutput(sphere)

# ==== cluster AddBranch
divisions = ClusterInput()
divisions_2 = Integer(divisions)

division = Division(A=divisions_2, B="2")
int = Integer(division)
multiplication = Multiplication(A=int, B="2")

radius = ClusterInput()
plane = ClusterInput()
radius_2 = Number(radius)
plane_2 = Plane(plane)
plane_3 = Plane(plane_2)
polygon = Polygon(Plane=plane_3, Radius=radius_2, Segments=multiplication, FilletRadius=0)  # -> Polygon, Length
offset = ClusterInput()
discontinuity = Discontinuity(Curve=polygon.Polygon, Level=1)  # -> Points, Parameters
offset_2 = Number(offset)
vector_2pt = Vector2Pt(PointA=plane_2, PointB=discontinuity.Points, Unitize=True)  # -> Vector, Length

list_length = ListLength(List=vector_2pt.Vector)
division_2 = Division(A=list_length, B="2")
int_2 = Integer(division_2)
multiplication_2 = Multiplication(A=int_2, B="2")

unit_z = UnitZ(Factor=offset_2)
point = Point(plane_2)

division_3 = Division(A=offset_2, B="2")
merge = Merge(Data1="0", Data2=division_3)
repeat_data = RepeatData(Data=merge, Length=multiplication_2)
unit_z_2 = UnitZ(Factor=repeat_data)

move = Move(Geometry=point, Motion=unit_z)  # -> Geometry, Transform

number = Number(radius_2)
division_4 = Division(A=number, B="3")
merge_2 = Merge(Data1=number, Data2=division_4)
repeat_data_2 = RepeatData(Data=merge_2, Length=multiplication_2)

amplitude = Amplitude(Vector=vector_2pt.Vector, Amplitude=repeat_data_2)

move_2 = Move(Geometry=point, Motion=amplitude)  # -> Geometry, Transform
move_3 = Move(Geometry=move_2.Geometry, Motion=unit_z_2)  # -> Geometry, Transform

line = Line(StartPoint=move.Geometry, EndPoint=move_3.Geometry)
loft = Loft(Curves=line, Options={Adjust=False, Closed=True, LoftEnds=0, LoftSimp=0, LoftType=1, Rebuild=10, Refit=0.01})
structure = Line(line)
brep = Brep(loft)
brep_2 = ClusterOutput(brep)
structure_2 = ClusterOutput(structure)

# ==== cluster AddDecoration
position = ClusterInput()
branches = ClusterInput()
position_2 = Curve(position)
branches_2 = Brep(branches)
project = Project(Curve=position_2, Brep=branches_2, Direction=Vector(0, 0, 1))  # -> simplify(Curve)
flip_matrix = FlipMatrix(Data=project)
flip_curve = FlipCurve(Curve=flip_matrix, Guide=position_2)  # -> Curve, Flag
negative = Negative(Value="16")
extend_curve = ExtendCurve(Curve=flip_curve.Curve, Type=0, Start=negative, End=negative)
divide_curve = DivideCurve(Curve=extend_curve, Count="4", Kinks=False)  # -> Points, Tangents, Parameters
shift_paths = ShiftPaths(Data=divide_curve.Points, Offset=-1)
radius = ClusterInput()
interpolate = Interpolate(Vertices=shift_paths, Degree=3, Periodic=False, KnotStyle=1)  # -> Curve, Length, Domain
unit_z = UnitZ(Factor=expr("x/2", radius))
move = Move(Geometry=interpolate.Curve, Motion=unit_z)  # -> flatten(Geometry), Transform
pipe = Pipe(Curve=move.Geometry, Radius=radius, Caps=2)  # -> flatten(Pipe)
count = ClusterInput()
populate_geometry = PopulateGeometry(Geometry=pipe, Count=count, Seed=1)
pipe_2 = ClusterOutput(pipe)
radius_2 = ClusterInput()
sphere = Sphere(Base=populate_geometry, Radius=radius_2)  # -> flatten(Sphere)
sphere_2 = ClusterOutput(sphere)
